# Grasshopper definition Hollow_Box-Section.gh (Grasshopper 1.0.8)
# plug-ins: CORE.Toolbox.Grasshopper, GhVa30, BH.UI.Grasshopper, Parakeet

box_section = ValueList({"Legacy - Tubes", "Rectangular Hollow Section", "Square Hollow Section"}, selected="Square Hollow Section")
i_section_name = ValueList({"SHS 25x25x2.6": 0, "SHS 25x25x3.2": 1, "SHS 30x30x2.6": 2, "SHS 30x30x3.2": 3, "SHS 30x30x4": 4, "SHS 32x32x2.6": 5, "SHS 32x32x3.2": 6, "SHS 32x32x4": 7, "SHS 35x35x2.6": 8, "SHS 35x35x3.2": 9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}, selected="SHS 40x40x4": 19)
units = ValueList({"Millimeter to Meter": 0.001, "Meter to Millimeter": 1000, "Millimeter": 1}, selected="Millimeter")
toggle = BooleanToggle(True)
path = FilePath("D:\work Files\Planning and Designing Informations\BHOM-STEEL_SECTIONS_INDIA\Profile-Sectioins\Hollow_Box-Section.xlsx")
xl_in = ReadFromExcel(WorkbookFilepath=path, WorksheetName=box_section, Range="A2:H115", Live=toggle, Stream=toggle)
flip = FlipMatrix(Data=xl_in)
concat = Concatenate(FragmentA="{0;", FragmentB="0", FragmentC="}")
concat_2 = Concatenate(FragmentA="{0;", FragmentB="1", FragmentC="}")
concat_3 = Concatenate(FragmentA="{0;", FragmentB="2", FragmentC="}")
concat_4 = Concatenate(FragmentA="{0;", FragmentB="4", FragmentC="}")
concat_5 = Concatenate(FragmentA="{0;", FragmentB="3", FragmentC="}")
concat_6 = Concatenate(FragmentA="{0;", FragmentB="5", FragmentC="}")
concat_7 = Concatenate(FragmentA="{0;", FragmentB="6", FragmentC="}")
split = SplitTree(Data=flip, Masks=flatten(concat))  # -> Positive, Negative
split_2 = SplitTree(Data=flip, Masks=flatten(concat_2))  # -> Positive, Negative
split_3 = SplitTree(Data=flip, Masks=flatten(concat_3))  # -> Positive, Negative
split_4 = SplitTree(Data=flip, Masks=flatten(concat_4))  # -> Positive, Negative
split_5 = SplitTree(Data=flip, Masks=flatten(concat_5))  # -> Positive, Negative
split_6 = SplitTree(Data=flip, Masks=flatten(concat_6))  # -> Positive, Negative
split_7 = SplitTree(Data=flip, Masks=flatten(concat_7))  # -> Positive, Negative
vlist_cntl = ValueListControler(ValueList=i_section_name, ItemsName=split_2.Positive, ItemsValue=split.Positive)
item = ListItem(List=split_3.Positive, Index=i_section_name, Wrap=True)
item_2 = ListItem(List=split_4.Positive, Index=i_section_name, Wrap=True)
item_3 = ListItem(List=split_6.Positive, Index=i_section_name, Wrap=True)
item_4 = ListItem(List=split.Positive, Index=i_section_name, Wrap=True)
item_5 = ListItem(List=split_5.Positive, Index=i_section_name, Wrap=True)
item_6 = ListItem(List=split_7.Positive, Index=i_section_name, Wrap=True)
item_7 = ListItem(List=split_2.Positive, Index=i_section_name, Wrap=True)
multiplication = Multiplication(A=item_5, B=units)
multiplication_2 = Multiplication(A=item_3, B=units)
multiplication_3 = Multiplication(A=item_6, B=units)
multiplication_4 = Multiplication(A=item, B=units)
multiplication_5 = Multiplication(A=item_2, B=units)
boxprofile = BoxProfile(
    Height=multiplication_4,
    Width=multiplication,
    Thickness=multiplication_5,
    OuterRadius=multiplication_2,
    InnerRadius=multiplication_3,
    Component="{ .BoxProfile")
steel = Steel(
    {"E250": 0, "E275": 1, "E300": 2, "E350": 3, "E410": 4, "E450": 5, "E550": 6, "E600": 7, "E650": 8}, selected="E275",
    Component="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",
    Selection=1)
explode = Explode(Object=boxprofile, Component="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")  # -> Shape, Height, Width, Thickness, OuterRadius, InnerRadius, Edges, BHoM_Guid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
steelsectionfromprofile = SteelSectionFromProfile(Profile=boxprofile, Material=steel, Name=item_7, Component="{ .SteelSectionFromProfile")
recthprof = RectangularHollowProfile(Name=item_7, Width=explode.Width, Height=explode.Height, Thickness=explode.Thickness, FilletRadius=0, InnerRadius=0)
list = BeamAlignment({"Top Left": 0, "Top Middle": 1, "Top Right": 2, "Middle Left": 3, "Center": 4, "Middle Right": 5, "Bottom Left": 6, "Bottom Middle": 7, "Bottom Right": 8}, selected="Bottom Right")
list_2 = ColumnAlignment({"Top Left": 0, "Top Middle": 1, "Top Right": 2, "Middle Left": 3, "Center": 4, "Middle Right": 5, "Bottom Left": 6, "Bottom Middle": 7, "Bottom Right": 8}, selected="Center")
beamsty = BeamStyle(Name=item_7, Profile=recthprof, Sizes={RefHandle=0, RefName=""})
columnsty = ColumnStyle(
    Name=item_7,
    Profile=recthprof,
    Sizes={RefHandle=0, RefName=""},
    Height=2.7,
    ModelBlock={RefHandle=0, RefName=""},
    PlanBlock={RefHandle=0, RefName=""})
beamopts = BeamOptions(
    Style=beamsty,
    Profile={RefHandle=0, RefName=""},
    Align=list,
    Rotation=0,
    StartCutPlane=0,
    EndCutPlane=0,
    ProfileMirrored=False)
columnopts = ColumnOptions(
    Style=columnsty,
    Profile={RefHandle=0, RefName=""},
    Align=list_2,
    Rotation=0,
    Height=0,
    Column=Vector(0, 0, 0),
    Direction=False,
    Geometry=1)
column = Column(Position=PlaneXY(0, 0, 0), Options=columnopts)
beam = Beam(Curve=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, Options=beamopts)
