# Grasshopper definition Hollow_Circular-Section.gh (Grasshopper 1.0.8)
# plug-ins: CORE.Toolbox.Grasshopper, GhVa30, BH.UI.Grasshopper, Parakeet

box_section = ValueList({"Legacy - Pipe", "Circular Hollow Section"}, selected="Circular Hollow Section")
i_section_name = ValueList({"CHS 21.3x2": 0, "CHS 21.3x2.6": 1, "CHS 21.3x3.2": 2, "CHS 26.9x2.3": 3, "CHS 26.9x2.6": 4, "CHS 26.9x3.2": 5, "CHS 33.7x2.6": 6, "CHS 33.7x3.2": 7, "CHS 33.7x4": 8, "CHS 42.4x2.6": 9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}, selected="CHS 355.6x12": 80)
units = ValueList({"Millimeter to Meter": 0.001, "Meter to Millimeter": 1000, "Millimeter": 1}, selected="Millimeter to Meter")
toggle = BooleanToggle(True)
path = FilePath("D:\work Files\Planning and Designing Informations\BHOM-STEEL_SECTIONS_INDIA\Profile-Sectioins\Hollow_Circular-Section.xlsx")
xl_in = ReadFromExcel(WorkbookFilepath=path, WorksheetName=box_section, Range="A2:H85", Live=toggle, Stream=toggle)
profile = ProfileByName(outputListLength=0)
flip = FlipMatrix(Data=xl_in)
concat = Concatenate(FragmentA="{0;", FragmentB="0", FragmentC="}")
concat_2 = Concatenate(FragmentA="{0;", FragmentB="1", FragmentC="}")
concat_3 = Concatenate(FragmentA="{0;", FragmentB="2", FragmentC="}")
concat_4 = Concatenate(FragmentA="{0;", FragmentB="3", FragmentC="}")
split = SplitTree(Data=flip, Masks=flatten(concat))  # -> Positive, Negative
split_2 = SplitTree(Data=flip, Masks=flatten(concat_2))  # -> Positive, Negative
split_3 = SplitTree(Data=flip, Masks=flatten(concat_3))  # -> Positive, Negative
split_4 = SplitTree(Data=flip, Masks=flatten(concat_4))  # -> Positive, Negative
vlist_cntl = ValueListControler(ValueList=i_section_name, ItemsName=split_2.Positive, ItemsValue=split.Positive)
item = ListItem(List=split_3.Positive, Index=i_section_name, Wrap=True)
item_2 = ListItem(List=split.Positive, Index=i_section_name, Wrap=True)
item_3 = ListItem(List=split_4.Positive, Index=i_section_name, Wrap=True)
item_4 = ListItem(List=split_2.Positive, Index=i_section_name, Wrap=True)
multiplication = Multiplication(A=item_3, B=units)
multiplication_2 = Multiplication(A=item, B=units)
tubeprofile = TubeProfile(Diameter=multiplication_2, Thickness=multiplication, Component="{ .TubeProfile")
steel = Steel(
    {"E250": 0, "E275": 1, "E300": 2, "E350": 3, "E410": 4, "E450": 5, "E550": 6, "E600": 7, "E650": 8}, selected="E275",
    Component="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",
    Selection=1)
steelsectionfromprofile = SteelSectionFromProfile(Profile=tubeprofile, Material=steel, Name=item_4, Component="{ .SteelSectionFromProfile")
explode = Explode(Object=tubeprofile, Component="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")  # -> Shape, Diameter, Thickness, Edges, BHoM_Guid, Name, Fragments, Tags, CustomData
division = Division(A=explode.Diameter, B=2)
circhprof = CircularHollowProfile(Name=item_4, Radius=division, Thickness=explode.Thickness)
list = BeamAlignment({"Top Left": 0, "Top Middle": 1, "Top Right": 2, "Middle Left": 3, "Center": 4, "Middle Right": 5, "Bottom Left": 6, "Bottom Middle": 7, "Bottom Right": 8}, selected="Center")
list_2 = ColumnAlignment({"Top Left": 0, "Top Middle": 1, "Top Right": 2, "Middle Left": 3, "Center": 4, "Middle Right": 5, "Bottom Left": 6, "Bottom Middle": 7, "Bottom Right": 8}, selected="Center")
beamsty = BeamStyle(Name=item_4, Profile=circhprof, Sizes={RefHandle=0, RefName=""})
columnsty = ColumnStyle(
    Name=item_4,
    Profile=circhprof,
    Sizes={RefHandle=0, RefName=""},
    Height=2.7,
    ModelBlock={RefHandle=0, RefName=""},
    PlanBlock={RefHandle=0, RefName=""})
beamopts = BeamOptions(
    Style=beamsty,
    Profile={RefHandle=0, RefName=""},
    Align=list,
    Rotation=0,
    StartCutPlane=0,
    EndCutPlane=0,
    ProfileMirrored=False)
columnopts = ColumnOptions(
    Style=columnsty,
    Profile={RefHandle=0, RefName=""},
    Align=list_2,
    Rotation=0,
    Height=0,
    Column=Vector(0, 0, 0),
    Direction=False,
    Geometry=1)
beam = Beam(Curve=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, Options=beamopts)
column = Column(Position=PlaneXY(0, 0, 0), Options=columnopts)
