# Grasshopper definition I-Section.gh (Grasshopper 1.0.8)
# plug-ins: CORE.Toolbox.Grasshopper, GhVa30, BH.UI.Grasshopper, Parakeet

units = ValueList({"Millimeter to Meter": 0.001, "Meter to Millimeter": 1000, "Millimeter": 1}, selected="Millimeter to Meter")
i_section_name = ValueList({"WPB100X100X16.67": 1, "WPB100X100X20.44": 2, "WPB100X100X41.79": 3, "WPB120X120X14.57": 4, "WPB120X120X19.89": 5, "WPB120X120X26.70": 6, "WPB120X120X52.13": 7, "WPB140X140X18.08": 8, "WPB140X140X24.66": 9, "WPB140X140X33.72": 10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}, selected="WPB600X300X211.92": 100)
sections = ValueList({"I - Beam", "I - Column", "I - PBP", "I - WBP"}, selected="I - WBP")
toggle = BooleanToggle(True)
path = FilePath("D:\work Files\Planning and Designing Informations\BHOM-STEEL_SECTIONS_INDIA\Profile-Sectioins\I-SECTION.xlsx")
xl_in = ReadFromExcel(WorkbookFilepath=path, WorksheetName=sections, Range="A3:H125", Live=toggle, Stream=toggle)
flip = FlipMatrix(Data=xl_in)
concat = Concatenate(FragmentA="{0;", FragmentB="0", FragmentC="}")
concat_2 = Concatenate(FragmentA="{0;", FragmentB="1", FragmentC="}")
concat_3 = Concatenate(FragmentA="{0;", FragmentB="2", FragmentC="}")
concat_4 = Concatenate(FragmentA="{0;", FragmentB="4", FragmentC="}")
concat_5 = Concatenate(FragmentA="{0;", FragmentB="3", FragmentC="}")
concat_6 = Concatenate(FragmentA="{0;", FragmentB="5", FragmentC="}")
concat_7 = Concatenate(FragmentA="{0;", FragmentB="6", FragmentC="}")
concat_8 = Concatenate(FragmentA="{0;", FragmentB="7", FragmentC="}")
split = SplitTree(Data=flip, Masks=flatten(concat))  # -> Positive, Negative
split_2 = SplitTree(Data=flip, Masks=flatten(concat_2))  # -> Positive, Negative
vlist_cntl = ValueListControler(ValueList=i_section_name, ItemsName=split_2.Positive, ItemsValue=split.Positive)
split_3 = SplitTree(Data=flip, Masks=flatten(concat_3))  # -> Positive, Negative
split_4 = SplitTree(Data=flip, Masks=flatten(concat_4))  # -> Positive, Negative
split_5 = SplitTree(Data=flip, Masks=flatten(concat_5))  # -> Positive, Negative
split_6 = SplitTree(Data=flip, Masks=flatten(concat_6))  # -> Positive, Negative
split_7 = SplitTree(Data=flip, Masks=flatten(concat_7))  # -> Positive, Negative
split_8 = SplitTree(Data=flip, Masks=flatten(concat_8))  # -> Positive, Negative
item = ListItem(List=split_3.Positive, Index=i_section_name, Wrap=True)
item_2 = ListItem(List=split_4.Positive, Index=i_section_name, Wrap=True)
item_3 = ListItem(List=split_6.Positive, Index=i_section_name, Wrap=True)
item_4 = ListItem(List=split_8.Positive, Index=i_section_name, Wrap=True)
item_5 = ListItem(List=split.Positive, Index=i_section_name, Wrap=True)
item_6 = ListItem(List=split_5.Positive, Index=i_section_name, Wrap=True)
item_7 = ListItem(List=split_7.Positive, Index=i_section_name, Wrap=True)
item_8 = ListItem(List=split_2.Positive, Index=i_section_name, Wrap=True)
multiplication = Multiplication(A=item_4, B=units)
multiplication_2 = Multiplication(A=item_6, B=units)
multiplication_3 = Multiplication(A=item_3, B=units)
multiplication_4 = Multiplication(A=item_7, B=units)
multiplication_5 = Multiplication(A=item, B=units)
multiplication_6 = Multiplication(A=item_2, B=units)
isectionprofile = ISectionProfile(
    Height=multiplication_5,
    Width=multiplication_6,
    WebThickness=multiplication_2,
    FlangeThickness=multiplication_3,
    RootRadius=multiplication_4,
    ToeRadius=multiplication,
    Component="{ .ISectionProfile")
steel = Steel(
    {"E250": 0, "E275": 1, "E300": 2, "E350": 3, "E410": 4, "E450": 5, "E550": 6, "E600": 7, "E650": 8}, selected="E410",
    Component="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",
    Selection=4)
explode = Explode(Object=isectionprofile, Component="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")  # -> Height, Width, WebThickness, FlangeThickness, RootRadius, ToeRadius, Shape, Edges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
steelsectionfromprofile = SteelSectionFromProfile(Profile=isectionprofile, Material=steel, Name=item_8, Component="{ .SteelSectionFromProfile")
iprofile = IProfile(
    Name=item_8,
    Depth=explode.Height,
    Width=explode.Width,
    WebThickness=explode.WebThickness,
    FlangeThickness=explode.FlangeThickness,
    FilletRadius=explode.RootRadius,
    FlangeEdgeRadius=explode.ToeRadius,
    FlangeSlopeAngle=0)
list = BeamAlignment({"Top Left": 0, "Top Middle": 1, "Top Right": 2, "Middle Left": 3, "Center": 4, "Middle Right": 5, "Bottom Left": 6, "Bottom Middle": 7, "Bottom Right": 8}, selected="Bottom Middle")
list_2 = ColumnAlignment({"Top Left": 0, "Top Middle": 1, "Top Right": 2, "Middle Left": 3, "Center": 4, "Middle Right": 5, "Bottom Left": 6, "Bottom Middle": 7, "Bottom Right": 8}, selected="Center")
beamsty = BeamStyle(Name="New beam style", Profile=iprofile, Sizes={RefHandle=0, RefName=""})
columnsty = ColumnStyle(
    Name="New column style",
    Profile=iprofile,
    Sizes={RefHandle=0, RefName=""},
    Height=2.7,
    ModelBlock={RefHandle=0, RefName=""},
    PlanBlock={RefHandle=0, RefName=""})
beamopts = BeamOptions(
    Style=beamsty,
    Profile={RefHandle=0, RefName=""},
    Align=list,
    Rotation=0,
    StartCutPlane=0,
    EndCutPlane=0,
    ProfileMirrored=False)
columnopts = ColumnOptions(
    Style=columnsty,
    Profile={RefHandle=0, RefName=""},
    Align=list_2,
    Rotation=0,
    Height=0,
    Column=Vector(0, 0, 0),
    Direction=False,
    Geometry=1)
beam = Beam(Curve=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, Options=beamopts)
column = Column(Position=PlaneXY(0, 0, 0), Options=columnopts)
